# Grasshopper definition CSharpWIP.gh (Grasshopper 0.9.76)

curve = Curve(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)
curve_2 = Curve(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)
number_slider = Slider(9, range=0..19)
number_slider_2 = Slider(17, range=0..19)
number_slider_3 = Slider(180, range=0..360)
curve_3 = Curve([<curve referenced from the Rhino model> x2])
deconstruct_brep = DeconstructBrep(Brep=curve_3)  # -> Faces, Edges, Vertices
c_script = CSharpScript(x=curve_3, y=Slider(34, range=0..100), z=Slider(30, range=0..100), u=Slider(100, range=0..100))  # -> out, A, B, C, D; inputs x: list of Curve, y: Int32, z: Int32, u: Int32
# ---------- c_script: C# ----------
    List<Curve> cur = x;

    Curve c = cur[0];
    Curve cO = cur[1];

    Point3d[] pointsA;
    Point3d[] pointsB;

    c.DivideByCount(y, true, out pointsA);
    cO.DivideByCount(y, true, out pointsB);

    if(z > y - 1)
    {

      z = y - 1;

    }

    if(z == 0)
    {

      z = 1;

    }

    if(u > y - 1)
    {

      u = y - 1;

    }

    Vector3d referencePoint = new Vector3d(pointsA[0]);
    Vector3d vO = new Vector3d(pointsA[u]);
    Vector3d vT = new Vector3d(pointsB[z]);

    vT -= vO;
    c.Translate(vT);

    Rhino.Geometry.Intersect.CurveIntersections ci;
    ci = Rhino.Geometry.Intersect.Intersection.CurveCurve(c, cO, 0.001, 0.001);
    Point3d[] intPtsO = new Rhino.Geometry.Point3d[ci.Count];

    for(int i = 0; i < ci.Count; i++)
    {

      intPtsO[i] = ci[i].PointA;

    }

    if(ci.Count > 1)
    {

      vO = new Vector3d(intPtsO[0]);
      vT = new Vector3d(pointsB[z - 1]);

      vT -= vO;
      c.Translate(vT);

      Rhino.Geometry.Intersect.CurveIntersections cu;
      cu = Rhino.Geometry.Intersect.Intersection.CurveCurve(c, cO, 0.001, 0.001);
      intPtsO = new Rhino.Geometry.Point3d[cu.Count];

      for(int i = 0; i < cu.Count; i++)
      {

        intPtsO[i] = cu[i].PointA;

      }

    }

    A = c;
    B = cO;
    Point3d p = new Point3d(pointsA[u]);
    Point3d pO = new Point3d(pointsB[z]);
    //p -= pO;
    C = pO;
    D = intPtsO;
    //A = c.CurvatureAt(parameters);
# ---------- end c_script ----------
c_script_2 = CSharpScript(
    A=curve,
    B=curve_2,
    x=Slider(20, range=0..50),
    l=Slider(0, range=0..100),
    y=number_slider,
    z=number_slider_2,
    u=number_slider_3)  # -> out, AOut, APoints, BPoints, End, CurveA, CurveB, Intersect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; inputs A: Curve, B: Curve, x: Int32, l: Int32, y: Int32, z: Int32, u: Double
# ---------- c_script_2: C# ----------
    Curve a = A;
    Point3d[] pointsA;
    a.DivideByCount(x, true, out pointsA);

    Curve b = B;
    Point3d[] pointsB;
    b.DivideByCount(x, true, out pointsB);

    //End = b.PointAtEnd;


    if(l > x - 1)
    {

      l = (x - 1);
      outs = String.Format("l index is bigger than the size of the x collection");

    }

    /*
    List<Point3d> pointList = new List<Point3d>();
    for( int i = 0; i < pointsA.Length; i++ )
    {
      pointList.Add(pointsA[i]);
    }
    //foreach(Point3d point in pointList){}
    */

    Vector3d vec = new Vector3d(pointsB[l]);
    Vector3d one = new Vector3d(a.PointAtEnd);
    vec -= one;

    a.Translate(vec);

    CurveA = a;
    CurveB = b;

    Rhino.Geometry.Intersect.CurveIntersections ci;
    ci = Rhino.Geometry.Intersect.Intersection.CurveCurve(a, b, 0.001, 0.001);
    Point3d[] intPts = new Rhino.Geometry.Point3d[ci.Count];

    Point3d[] ptsA;
    a.DivideByCount(x, true, out ptsA);
    two = ptsA;

    End = a.PointAtEnd;

    for(int i = 0; i < ci.Count; i++)
    {

      intPts[i] = ci[i].PointA;

    }
    Intersect = intPts;

    if(ci.Count > 1)
    {


      Vector3d vO = new Vector3d(ptsA[z]);
      three = vO;
      Vector3d vT = new Vector3d(pointsB[y]);
      three = vT;
      vT -= vO;
      a.Translate(vT);

      /*
      Random r = new Random();
      foreach (int i in Enumerable.Range(0, 9).OrderBy(t => r.Next()))
      {
        four = i;
      }
      */

      /*
      List<Vector3d> pAList = new List<Vector3d>();
      Vector3d pA;
      List<Vector3d> pBList = new List<Vector3d>();
      Vector3d pB;
      */
      /*
      for(int i = 0; i < x; ++i)
      {

        //Vector3d[] p = new Vector3d[](ptsA[i]);
        //Vector3d[] pO = new Vector3d[](pointsB[j]);
        //p -= pO;
        //three = p;
        //a.Translate(p[1]);
        pA = new Vector3d(ptsA[i]);
        pB = new Vector3d(pointsB[i]);
        pAList.Add(pA);
        pBList.Add(pB);
        three = pAList;
        four = pBList;

      }
      */

      //a.Rotate(u * (Math.PI / 180), Vector3d.ZAxis, pointsB[y]);

      Rhino.Geometry.Intersect.CurveIntersections c;
      c = Rhino.Geometry.Intersect.Intersection.CurveCurve(a, b, 0.001, 0.001);
      Point3d[] intPtsO = new Rhino.Geometry.Point3d[c.Count];

      for(int i = 0; i < c.Count; i++)
      {

        intPtsO[i] = c[i].PointA;

      }
      IntersectTwo = intPtsO;
      four = c.Count;

      //Point3d p = new Point3d(ci[0].PointA);

      //Vector3d v = new Vector3d(p);

      /*
      Vector3d vO = new Vector3d(pointsA[l]);
      vec += vO;
      a.Translate(vec);
      */

      //Transform trans = Transform.Rotation(u, vec, ci[0].PointA);

      outs = String.Format("More than one collision");
      //oner = v;

    }

    else if( ci.Count == 1 )
    {

      outs = String.Format("Only one collision");

    }

    APoints = pointsA;
    BPoints = pointsB;
    AOut = String.Format(a + "\n" + b);
    //End = Counter();
# ---------- c_script_2: C# additional code ----------
  public Point3d Counter()
  {

    Point3d pt = new Point3d(1, 1, 1);
    return pt;

  }
# ---------- end c_script_2 ----------
curve_4 = Curve(c_script.A)
curve_5 = Curve(c_script.B)
point = Point(c_script.C)
point_2 = Point(c_script.D)
aoriginalpoints = Point(c_script_2.APoints)
boriginalpoints = Point(c_script_2.BPoints)
intersecttwo = Point(c_script_2.IntersectTwo)
intersectone = Point(c_script_2.Intersect)
pointanew = Point(c_script_2.two)
endpoints = Point(c_script_2.End)
curvea = Curve(c_script_2.CurveA)
panel = Panel(c_script_2.oner)
curveb = Curve(c_script_2.CurveB)
point_3 = Point(c_script_2.three)
panel_2 = Panel(c_script_2.outs)
vector = Vector(c_script_2.oner)
panel_3 = Panel(endpoints)
panel_4 = Panel(intersectone)
panel_5 = Panel(intersecttwo)
panel_6 = Panel(pointanew)
panel_7 = Panel(c_script_2.three)
panel_8 = Panel(c_script_2.four)
bounding_box = BoundingBox(Content=curveb, Plane=PlaneXY(0, 0, 0))  # -> Box, Box_2
bounding_box_2 = BoundingBox(Content=curvea, Plane=PlaneXY(0, 0, 0))  # -> Box, Box_2
brep = Brep(curveb)
brep_2 = Brep(curvea)
number = Number(panel_8)
galapagos = Galapagos(fitness=addition, gene=[number_slider, number_slider_2, number_slider_3])
divide_curve = DivideCurve(Curve=curvea, Count=Slider(40, range=0..100), Kinks=False)  # -> Points, Tangents, Parameters
perp_frame = PerpFrame(Curve=curvea, Parameter=divide_curve.Parameters)
deconstruct_plane = DeconstructPlane(Plane=perp_frame)  # -> Origin, XAxis, YAxis, ZAxis
area = Area(Geometry=[bounding_box.Box, bounding_box_2.Box])  # -> Area, Centroid
line_sdl = LineSDL(Start=perp_frame, Direction=deconstruct_plane.YAxis, Length=Slider(100, range=0..100))
mass_addition = MassAddition(Input=area.Area)  # -> Result, PartialResults
number_2 = Number(mass_addition.Result)
addition = Addition(A=number_2, B=number)
panel_9 = Panel(addition)
